# Grasshopper definition annotation_test.gh (Grasshopper 1.0.7)
# plug-ins: GrasshopperPRT

path = FilePath("C:\Users\lor11212\Documents\Rhino\rhino-plugin-prototype\TestCases\annotations_test.rpk")
rec = Rectangle({Plane=PlaneXY(3, 27.5, 0), Size=Domain2(u=-11..11, v=-20.5..20.5)})
ghprt = GrasshopperPRT(PathToRPK=path, InitialShapes=rec, DefaultSetBack=Slider(0.25, range=0..1))  # -> GeneratedShapes, Reports
