# Grasshopper definition parthenon_test.gh (Grasshopper 1.0.7)
# plug-ins: GrasshopperPRT

path = FilePath("C:\Users\lor11212\Documents\Rhino\rhino-plugin-prototype\parthenon.rpk")
rec = Rectangle({Plane=PlaneXY(2.5, 6.5, 0), Size=Domain2(u=-11.5..11.5, v=-18.5..18.5)})
col = Colour(RGB(232, 30, 30))
ghprt = GrasshopperPRT(PathToRPK=path, InitialShapes=rec, DefaultLevel_of_Detail="Low", DefaultRoof_Color=col)
panel = Panel(ghprt)
